# Grasshopper definition Paperhopper_2_PLAY_TEMPLATE.gh (Grasshopper 1.0.7)
# plug-ins: InteracTool, Human, gHowl, LunchBox, Telepathy

# Paperhopper_2_PLAY_TEMPLATE
# PaperHopper
# github.com/dantaeyoung/paperhopper
# -- CALIBRATION:
# 
# You must run this file after calibration!
# 
# If you haven't calibrated, close this file, then open
# 'Paperhopper_1_CALIBRATION.gh'.
# 
# If you have calibrated: Great! Save this file as a new file, then start playing.
# 
# -- PLUGINS:
# 
# This file requires several crucial plugins:
# - Human
# - gHowl
# - Lunchbox
# - Telepathy
# - Bengesht
# If you see errors, then load the plugins into Grasshopper, then close without saving and reopen this file.
# The plugins are conveniently collected in the gh_plugins folder.
# Dan Taeyoung / @dantaeyoung
# Receive and calibrate data from Reactivision based on `calibration.xml`
# If this doesn't work, follow these instructions:
listentocalibration_py = BooleanToggle(True)
update_calibration_data = Button()
filter = StreamFilter(Gate=listentocalibration_py, Stream1="3334")
gs_loadcalibrationdata = GSLoadCalibrationData(update=update_calibration_data)  # -> calibrationmmv, calibrationadjustment, playspacerectangle
udp = UDPReceiver(Port=filter, Pattern="999")  # -> Info, Data
turn_on_green_detection_circles = BooleanToggle(True)
show_playspace_rectangle = BooleanToggle(False)
# v0.2
# SETUP
parsecalibrateddata = ParseCalibratedData(calibrateddata=udp.Data)  # -> calibratedids_2, calibratedanglesfrom0to1_2, calibratedplanes_2, allcalibrateddata_2
detectioncircleradius = RemoteSender(Slider(10, range=0..100))
playspacerectangle = Geometry(gs_loadcalibrationdata.playspacerectangle)
detectioncirclecolor = RemoteSender(ColourSwatch(SwatchColor=RGB(34, 97, 7)))
detectioncircleradius_2 = RemoteReceiver(detectioncircleradius)
calibratedids = RemoteSender(parsecalibrateddata.calibratedids_2)
calibratedplanes = RemoteSender(parsecalibrateddata.calibratedplanes_2)

calibratedplanes_2 = RemoteReceiver(calibratedplanes)
turn_on_blobs = BooleanToggle(True)
stream_filter = StreamFilter(Gate=turn_on_blobs, Stream1=calibratedplanes_2)
number_slider = Slider(0.003, range=0..0.003)
delaunay_edges = DelaunayEdges(Points=flatten(stream_filter), Plane=PlaneXY(0, 0, 0))  # -> Connectivity, Edges
metaball_t = MetaBallT(Points=flatten(stream_filter), Plane=PlaneXY(0, 0, 0), Threshold=Slider(0.0073, range=0..0.01))
length = Length(Curve=metaball_t)
# DEBUG
trim_with_regions = TrimWithRegions(Curve=delaunay_edges.Edges, Regions=metaball_t)  # -> Inside, Outside
geometry = Geometry(trim_with_regions.Outside)
gradient = Gradient(
    LowerLimit=0,
    UpperLimit=Slider(1867, range=0..100000),
    Parameter=length,
    stops=[0: RGB(243, 57, 0), 0.1: RGB(236, 27, 60), 0.2: RGB(210, 0, 118), 0.3: RGB(103, 0, 120), 0.4: RGB(39, 72, 161), 0.5: RGB(1, 192, 229), 0.6: RGB(18, 178, 90), 0.7: RGB(79, 186, 8), 0.8: RGB(220, 237, 32), 0.9: RGB(247, 159, 20), 1: RGB(243, 57, 0)])
custom_preview_lineweights = CustomPreviewLineweights(
    Geometry=geometry,
    Shader=ColourSwatch(SwatchColor=RGB(189, 111, 111)),
    Thickness=Slider(10, range=0..10),
    Absolute=False)
custom_preview_lineweights_2 = CustomPreviewLineweights(Geometry=metaball_t, Shader=gradient, Thickness=Slider(10, range=0..10), Absolute=False)

calibratedplanes_3 = RemoteReceiver(calibratedplanes)
filter_2 = StreamFilter(Gate=turn_on_green_detection_circles, Stream1=calibratedplanes_3)
calibratedanglesfrom0to1 = RemoteSender(parsecalibrateddata.calibratedanglesfrom0to1_2)
calibratedanglesfrom0to1_2 = RemoteReceiver(calibratedanglesfrom0to1)
allcalibrateddata = RemoteSender(parsecalibrateddata.allcalibrateddata_2)
detectioncirclecolor_2 = RemoteReceiver(detectioncirclecolor)
playspacerectangle_2 = RemoteSender(playspacerectangle)
playspacerectangle_3 = RemoteReceiver(playspacerectangle_2)
filter_3 = StreamFilter(Gate=show_playspace_rectangle, Stream1=playspacerectangle_3)
circle = Circle(Plane=filter_2, Radius=detectioncircleradius_2)
custom_preview_lineweights_3 = CustomPreviewLineweights(Geometry=filter_3, Shader=ColourSwatch(SwatchColor=RGB(148, 148, 148)), Thickness=Slider(2, range=0..10), Absolute=False)
multiplication = Multiplication(A=calibratedanglesfrom0to1_2, B=Slider(360, range=0..1000))

turn_on_debug = BooleanToggle(False)
calibratedplanes_4 = RemoteReceiver(calibratedplanes)
stream_filter_2 = StreamFilter(Gate=turn_on_debug, Stream1=calibratedplanes_4)
md_slider = MDSlider(
    SliderMode=0,
    slider_value=Point(0.9360868078, 0.6700220353, 0.5),
    x_domain=Domain(-30, 30),
    y_domain=Domain(-30, 30),
    z_domain=Domain(0, 1))
projectionscale_rhinooverirl = RemoteReceiver()
deconstruct_plane = DeconstructPlane(Plane=stream_filter_2)  # -> Origin, XAxis, YAxis, ZAxis
number_slider_2 = Slider(55, range=0..100)
calibratedids_2 = RemoteReceiver(calibratedids)
move = Move(Geometry=deconstruct_plane.Origin, Motion=md_slider)  # -> Geometry, Transform
deconstruct = Deconstruct(Point=deconstruct_plane.Origin)  # -> XComponent, YComponent, ZComponent
multiplication_2 = Multiplication(A=projectionscale_rhinooverirl, B=Slider(0.7, range=0..4))
line_sdl = LineSDL(Start=deconstruct_plane.Origin, Direction=deconstruct_plane.YAxis, Length=number_slider_2)
line_sdl_2 = LineSDL(Start=deconstruct_plane.Origin, Direction=deconstruct_plane.XAxis, Length=number_slider_2)
concatenate = Concatenate(
    FragmentH="ID: ",
    FragmentG=calibratedids_2,
    FragmentF="x: ",
    FragmentA=deconstruct.XComponent,
    FragmentB=", y: ",
    FragmentC=deconstruct.YComponent,
    FragmentD="rot: ",
    FragmentE=multiplication)
gradient_2 = Gradient(
    LowerLimit="0",
    UpperLimit="360",
    Parameter=multiplication,
    stops=[0: RGB(243, 57, 0), 0.1: RGB(236, 27, 60), 0.2: RGB(210, 0, 118), 0.3: RGB(103, 0, 120), 0.4: RGB(39, 72, 161), 0.5: RGB(1, 192, 229), 0.6: RGB(18, 178, 90), 0.7: RGB(79, 186, 8), 0.8: RGB(220, 237, 32), 0.9: RGB(247, 159, 20), 1: RGB(243, 57, 0)])
geometry_2 = Geometry([line_sdl_2, line_sdl])
# Undo / Redo
# DRWG
text_tag_3d = TextTag3D(Location=move.Geometry, Text=concatenate, Size=Slider(6, range=0..100), Colour=gradient_2, Justification=7)
custom_preview_lineweights_4 = CustomPreviewLineweights(
    Geometry=geometry_2,
    Shader={diffuse=RGB(255, 105, 180), emission=RGB(76, 32, 54), shine=0.5, specular=RGB(255, 255, 255), transparency=0},
    Thickness=Slider(6, range=0..10),
    Absolute=False)

custom_preview = CustomPreview(Geometry=circle, Material=detectioncirclecolor_2)
allcalibrateddata_2 = RemoteReceiver(allcalibrateddata)
ph_find_tags_v6 = PHFindTagsV6(tag_id="78", allcalibrateddata=allcalibrateddata_2)  # -> tag_id_exists_2, calibrated_planes_2, anglefrom0to1_2
panel = Panel("""3
9
145""")
# PLAY
# Use this component to find tags based on tag ID!
# Find tags based on tag ID
panel_2 = Panel("145")
allcalibrateddata_3 = RemoteReceiver(allcalibrateddata)
allcalibrateddata_4 = RemoteReceiver(allcalibrateddata)
panel_3 = Panel(ph_find_tags_v6.calibrated_planes_2)
panel_4 = Panel(ph_find_tags_v6.tag_id_exists_2)
panel_5 = Panel(ph_find_tags_v6.anglefrom0to1_2)
ph_find_tags_v6_2 = PHFindTagsV6(tag_id=panel, allcalibrateddata=allcalibrateddata_3)  # -> tag_id_exists_2, calibrated_planes_2, anglefrom0to1_2
ph_find_tags_v6_3 = PHFindTagsV6(tag_id=panel_2, allcalibrateddata=allcalibrateddata_4)  # -> tag_id_exists_2, calibrated_planes_2, anglefrom0to1_2
md_slider_2 = MDSlider(
    SliderMode=0,
    slider_value=Point(0.1661887527, 0.5650404023, 0.5),
    x_domain=Domain(-100, 100),
    y_domain=Domain(-100, 100),
    z_domain=Domain(0, 1))
panel_6 = Panel(ph_find_tags_v6_2.tag_id_exists_2)
panel_7 = Panel(ph_find_tags_v6_2.calibrated_planes_2)
panel_8 = Panel(ph_find_tags_v6_3.tag_id_exists_2)
panel_9 = Panel(ph_find_tags_v6_3.calibrated_planes_2)
panel_10 = Panel(ph_find_tags_v6_2.anglefrom0to1_2)
panel_11 = Panel(ph_find_tags_v6_3.anglefrom0to1_2)
rotate_plane = RotatePlane(Plane=ph_find_tags_v6.calibrated_planes_2, Angle="Pi")
moveplane = MovePlane(plane=rotate_plane, vector=md_slider_2)
detectioncirclecolor_3 = RemoteReceiver(detectioncirclecolor)
keyboard_event = KeyBoardEvent(Start=Slider(4, range=0..10))  # -> Current, Pressed, Toggled
text_tag_3d_2 = TextTag3D(
    Location=moveplane,
    Text="Keyboard",
    Size=Slider(10, range=0..10),
    Colour=ColourSwatch(SwatchColor=RGB(255, 255, 255)),
    Justification=5)
panel_12 = Panel(keyboard_event.Pressed)
md_slider_3 = MDSlider(
    SliderMode=0,
    slider_value=Point(0.5956845167, 0.6831815766, 0.5),
    x_domain=Domain(0, 1),
    y_domain=Domain(0, 1),
    z_domain=Domain(0, 1))
allcalibrateddata_5 = RemoteReceiver(allcalibrateddata)
playspacerectangle_4 = RemoteReceiver(playspacerectangle_2)
ph_find_tags_v6_4 = PHFindTagsV6(tag_id="5", allcalibrateddata=allcalibrateddata_5)  # -> tag_id_exists_2, calibrated_planes_2, anglefrom0to1_2
tag_is_visible = BooleanToggle(False)
panel_13 = Panel(ph_find_tags_v6_4.tag_id_exists_2)
panel_14 = Panel(ph_find_tags_v6_4.calibrated_planes_2)
prototype_tags = PrototypeTAGS(surface=playspacerectangle_4, boolean=tag_is_visible, point=md_slider_3, anglefrom0to1=Slider(0.83, range=0..1))  # -> tag_id_exists_2, calibrated_planes_2, anglefrom0to1_4
panel_15 = Panel(ph_find_tags_v6_4.anglefrom0to1_2)
anglefrom0to1 = Number(prototype_tags.anglefrom0to1_4)
calibrated_planes = Plane(prototype_tags.calibrated_planes_2)
tag_id_exists = Boolean(prototype_tags.tag_id_exists_2)
allcalibrateddata_6 = RemoteReceiver(allcalibrateddata)
ph_find_tags_v6_5 = PHFindTagsV6(tag_id="120", allcalibrateddata=allcalibrateddata_6)  # -> tag_id_exists_2, calibrated_planes_2, anglefrom0to1_2
panel_16 = Panel("_undo")
boolean_toggle = BooleanToggle(False)
rhino_command = RhinoCommand(SendCommandToggle=ph_find_tags_v6_5.tag_id_exists_2, CommandString="_SelAll _Enter _Delete _Enter")

# ==== cluster GSLoadCalibrationData
optional_filename = ClusterInput()
update = ClusterInput()
readcalibrationfile = ReadCalibrationFile(update=update, _0=optional_filename)
decodecalibrationdata = DecodeCalibrationData(jsondump=readcalibrationfile)  # -> calibrationmmv_2, calibrationadjustment_2, playspacerectangle_2
calibrationmmv = ClusterOutput(decodecalibrationdata.calibrationmmv_2)
calibrationadjustment = ClusterOutput(decodecalibrationdata.calibrationadjustment_2)
playspacerectangle = ClusterOutput(decodecalibrationdata.playspacerectangle_2)

# ==== cluster ParseCalibratedData
calibrateddata = ClusterInput()
calibrateddata_2 = Data(calibrateddata)
split_list = SplitList(List=calibrateddata_2, Index="1")  # -> ListA, ListB
partition_list = PartitionList(List=split_list.ListB, Size="4")
list_item = ListItem(List=partition_list, Index=0, Wrap=True)  # -> Item, Item1, Item2, Item3
construct_point = ConstructPoint(XCoordinate=list_item.Item1, YCoordinate=list_item.Item2, ZCoordinate=0)
multiplication = Multiplication(A=list_item.Item3, B="2 * Pi")
xy_plane = XYPlane(Origin=construct_point)
rotate_plane = RotatePlane(Plane=xy_plane, Angle=multiplication)
calibratedplanes = RemoteSender(rotate_plane)
calibratedids = RemoteSender(list_item.Item)
calibratedanglesfrom0to1 = RemoteSender(list_item.Item3)
entwine = Entwine(
    Branch00=simplify(calibratedids),
    Branch01=simplify(calibratedanglesfrom0to1),
    Branch02=simplify(calibratedplanes),
    FlattenInputs=True)
calibratedids_2 = ClusterOutput(calibratedids)
calibratedplanes_2 = ClusterOutput(calibratedplanes)
calibratedanglesfrom0to1_2 = ClusterOutput(calibratedanglesfrom0to1)
allcalibrateddata = Data(entwine)
allcalibrateddata_2 = ClusterOutput(allcalibrateddata)

# ==== cluster PHFindTagsV6
allcalibrateddata = ClusterInput()
allcalibrateddata_2 = Data(simplify(allcalibrateddata))
explode_tree = ExplodeTree(Data=allcalibrateddata_2)  # -> Branch0, Branch1, Branch2
calibratedids = Data(simplify(graft(explode_tree.Branch0)))
calibratedanglesfrom0to1 = Number(simplify(graft(explode_tree.Branch1)))
calibratedplanes = Data(simplify(graft(explode_tree.Branch2)))
tag_id = ClusterInput()
tag_id_2 = Number(tag_id)
match = MatchTree(Tree=calibratedplanes, Guide=calibratedids)
match_2 = MatchTree(Tree=calibratedanglesfrom0to1, Guide=calibratedids)
equality = Equality(FirstNumber=graft(tag_id_2), SecondNumber=simplify(flatten(calibratedids)))  # -> Equality, Inequality
tree_statistics = TreeStatistics(Tree=calibratedids)  # -> Paths, Length, Count
panel = Panel(calibratedplanes)
dispatch = Dispatch(List=tree_statistics.Paths, DispatchPattern=equality.Equality)  # -> ListA, ListB
panel_2 = Panel(tree_statistics.Paths)
tree_branch = TreeBranch(Tree=match, Path=dispatch.ListA, MaintainPaths=True)
tree_branch_2 = TreeBranch(Tree=match_2, Path=dispatch.ListA, MaintainPaths=True)
null_item = NullItem(Item=tree_branch_2)  # -> NullFlags, InvalidFlags, Description
gate_not = GateNot(A=null_item.NullFlags)
tag_id_exists = Boolean(gate_not)
calibrated_planes = Plane(tree_branch)
tag_id_exists_2 = ClusterOutput(tag_id_exists)
calibrated_planes_2 = ClusterOutput(calibrated_planes)
anglefrom0to1 = Number(tree_branch_2)
anglefrom0to1_2 = ClusterOutput(anglefrom0to1)

# ==== cluster MovePlane
vector = ClusterInput()
plane = ClusterInput()
vector_2 = Vector(vector)
plane_2 = Plane(plane)
deconstruct = Deconstruct(Point=vector_2)  # -> XComponent, YComponent, ZComponent
point_oriented = PointOriented(
    BasePlane=plane_2,
    UComponent=deconstruct.XComponent,
    VComponent=deconstruct.YComponent,
    WComponent=deconstruct.ZComponent)
align_planes = AlignPlanes(Planes=point_oriented, Master=plane_2)
planes = ClusterOutput(align_planes)

# ==== cluster PrototypeTAGS
surface = ClusterInput()
point = ClusterInput()
boolean = ClusterInput()
anglefrom0to1 = ClusterInput()
anglefrom0to1_2 = Number(anglefrom0to1)
evaluate_surface = EvaluateSurface(Surface=reparameterize(surface), Point=point)  # -> Point, Normal, UDirection, VDirection, Frame
multiplication = Multiplication(A=anglefrom0to1_2, B="2 * Pi")
xy_plane = XYPlane(Origin=evaluate_surface.Point)
rotate_plane = RotatePlane(Plane=xy_plane, Angle=multiplication)
boolean_2 = Boolean(boolean)
anglefrom0to1_3 = Number(anglefrom0to1_2)
anglefrom0to1_4 = ClusterOutput(anglefrom0to1_3)
calibrated_planes = Plane(rotate_plane)
calibrated_planes_2 = ClusterOutput(calibrated_planes)
tag_id_exists = Boolean(boolean_2)
tag_id_exists_2 = ClusterOutput(tag_id_exists)

# ==== cluster DecodeCalibrationData
jsondump = ClusterInput()
b64dump = ClusterInput()
deserializedata = DEserializeData(jsondump=jsondump, b64dump=b64dump)  # -> keys, vals
bang = ExplodeTree(Data=deserializedata.vals)  # -> Branch0, Branch1, Branch2
playspacerectanglepts = Geometry(bang.Branch2)
calibrationadjustment = Point(bang.Branch1)
calibrationmmv = Number(bang.Branch0)
polyline = PolyLine(Vertices=playspacerectanglepts, Closed=True)
calibrationmmv_2 = ClusterOutput(calibrationmmv)
calibrationadjustment_2 = ClusterOutput(calibrationadjustment)
playspacerectangle = Geometry(polyline)
playspacerectangle_2 = ClusterOutput(playspacerectangle)

# ==== cluster ReadCalibrationFile
update = ClusterInput()
_0 = ClusterInput()
update_2 = Data(update)
gh_filepath = GHFilepath()  # -> filepath, filedir
combine = CombineData(Input0=_0, Input1="calibration.csv")  # -> Result, Index
writecalibrationfile = GhPythonScript(update=update_2, filedir=gh_filepath.filedir, filename=combine.Result)  # -> out, jsondump
# ---------- writecalibrationfile: Python ----------
import ghpythonlib.treehelpers as th
import json
import os 


filepath = os.path.join(filedir, filename)

print filepath

with open(filepath, "r") as f:
    jsondump = f.read()
# ---------- end writecalibrationfile ----------
jsondump = ClusterOutput(writecalibrationfile.jsondump)
panel = Panel(writecalibrationfile.jsondump)

# ==== cluster DEserializeData
jsondump = ClusterInput()
b64dump = ClusterInput()
or = ClusterInput()
or_2 = Data(or)
python = GhPythonScript(jsondump=jsondump, b64dump=b64dump)  # -> out, keys, vals
# ---------- python: Python ----------
import ghpythonlib.treehelpers as th
import json
import base64


thisjsondump = jsondump
if(b64dump):
    thisjsondump = base64.b64decode(b64dump)

d = json.loads(thisjsondump)
keys = th.list_to_tree(d["keys"])
vals = th.list_to_tree(d["vals"])
# ---------- end python ----------
vals = ClusterOutput(python.vals)
keys = ClusterOutput(python.keys)

# ==== cluster GHFilepath
get_gh_filepath = GetGHFilepath()  # -> filepath, filedir
filedir = ClusterOutput(get_gh_filepath.filedir)
panel = Panel(get_gh_filepath.filepath)
filepath = ClusterOutput(get_gh_filepath.filepath)

# ==== cluster GetGHFilepath
get_gh_filepath = GhPythonScript()  # -> out, filepath, filedir
# ---------- get_gh_filepath: Python ----------
import os


thisdoc = ghenv.Component.OnPingDocument()

while thisdoc.FilePath is None:
    #we are inside a cluster
    thisdoc = thisdoc.Owner.OwnerDocument()

filepath = thisdoc.FilePath
filedir = os.path.dirname(filepath)
# ---------- end get_gh_filepath ----------
filedir = ClusterOutput(get_gh_filepath.filedir)
filepath = ClusterOutput(get_gh_filepath.filepath)
